# Grasshopper definition import_ply_to_rhino.gh (Grasshopper 1.0.8)

# ---- group: .ply file path
panel = Panel("G:\UVA\Research_Update\RSI\svo_extract\clip\frames_20260209_181427\")

# ---- group: idx timer
py3 = Python3Script(folder=panel, reset=Button(), run=Toggle(False), interval_ms="50")  # -> out, a
# ---------- py3: Python ----------
import os
import scriptcontext as sc
import Grasshopper

folder = folder.strip('"') if folder else None

if "idx" not in sc.sticky:
    sc.sticky["idx"] = 0

if reset:
    sc.sticky["idx"] = 0

path = None
count = 0

if run and folder and os.path.isdir(folder):
    files = sorted([f for f in os.listdir(folder) if f.lower().endswith(".ply")])
    count = len(files)
    if count > 0:
        if not reset:
            sc.sticky["idx"] = (sc.sticky["idx"] + 1) % count
        path = os.path.join(folder, files[sc.sticky["idx"]])

        def _reschedule(doc):
            ghenv.Component.ExpireSolution(False)

        Grasshopper.Instances.ActiveCanvas.Document.ScheduleSolution(
            max(1, int(interval_ms)), _reschedule
        )

index = sc.sticky["idx"]
a = path
# ---------- end py3 ----------

# ---- group: .ply file os reader
py3_2 = Python3Script(p=py3.a)  # -> out, a
# ---------- py3_2: Python ----------
import os
import Rhino

pc = None
ok = False

if p and os.path.isfile(p):
    with open(p, "r") as f:
        header = True
        count = 0
        for line in f:
            if line.startswith("element vertex"):
                count = int(line.split()[-1])
            if line.strip() == "end_header":
                header = False
                break

        if not header and count > 0:
            pc = Rhino.Geometry.PointCloud()
            for _ in range(count):
                line = f.readline()
                if not line:
                    break
                parts = line.split()
                if len(parts) >= 3:
                    pc.Add(Rhino.Geometry.Point3d(float(parts[0]), float(parts[1]), float(parts[2])))
            ok = pc.Count > 0

a = pc
b = ok
# ---------- end py3_2 ----------

# ----
panel_2 = Panel(py3.a)
pcloud = PointCloud(py3_2.a)
panel_3 = Panel(pcloud)
